# Grasshopper definition OSC-Receiver-Test.ghx (Grasshopper 0.9.76)
# plug-ins: gHowl

pt = Point(Point(0, 0, 0))
pt_2 = Point(Point(100, 100, 100))
box = Box2Pt(PointA=pt, PointB=pt_2, Plane=PlaneXY(0, 0, 0))
udp = UDPReceiver(Port=Slider(5555, range=0..10000), Pattern=Slider(999, range=0..1000))  # -> Info, Data
item = ListItem(List=udp.Data, Index=0, Wrap=True)  # -> Item, Item1, Item2, Item3
panel = Panel(udp.Data)
rgb = ColourRGB(Alpha=255, Red=item.Item1, Green=item.Item2, Blue=item.Item3)
preview = CustomPreview(Geometry=box, Shader=rgb)
